# Grasshopper definition AutomateTheBoring_001_TUTORIAL.gh (Grasshopper 1.0.7)
# plug-ins: Hops

binmult = Hops(
    A=Slider(3, range=0..10),
    B=Slider(3, range=0..10),
    CacheResultsInMemory=True,
    CacheSolveResults=True,
    RemoteDefinitionLocation="http://127.0.0.1:5000/binmult",
    RemoteSolveVersion=(0, 1, 0),
    ShowInput_Enabled=False,
    ShowInput_Path=False,
    SynchronousSolve=True)
# Automate the Boring
# Stuff with Python
# Search for text in a file or across multiple files
# Create, update, move, and rename files and folders
# Search the Web and download online content
# Update and format data in Excel spreadsheets of any size
# Split, merge, watermark, and encrypt PDFs
# Send reminder emails and text notifications
# Fill out online forms
# With
# Github
# Co-Pilot!!!
panel = Panel(binmult)
# Python Basics
panel_2 = Panel("Michael")
hello = Hops(
    Name=panel_2,
    CacheResultsInMemory=True,
    CacheSolveResults=True,
    RemoteDefinitionLocation="http://127.0.0.1:5000/hello",
    RemoteSolveVersion=(0, 1, 0),
    ShowInput_Enabled=False,
    ShowInput_Path=False,
    SynchronousSolve=True)
panel_3 = Panel(hello)
